# Grasshopper definition WorkingCopy2nomap.gh (Grasshopper 1.0.7)
# plug-ins: UserDataUtils

int = Integer(5)
xz = XZPlane(Origin=Point(0, 0, 0))
scale_nu = ScaleNU(Geometry=[<mesh referenced from the Rhino model> x45], Plane=xz, ScaleX=1, ScaleY=Slider(2.288, range=2..5), ScaleZ=1)  # -> Geometry, Transform
c_script = CSharpScript()  # -> Out, A
maze_stream = DataSender(A=scale_nu.Geometry, manualmode=False, remotecontroller=False)  # -> Log, StreamId
panel = Panel(maze_stream.Log)
